# Grasshopper definition Dawid_app_prototype_10.gh (Grasshopper 1.0.7)
# plug-ins: Urbano, ShapeDiverForGrasshopper, Mesh Pipe

sddp = ShapeDiverDocumentPayload({AbsoluteTolerance=0, AngleTolerance=0, DistanceDisplayPrecision=0, GltfVersion="Gltf2", GrasshopperVersion="1.0.0007", InputGroups="{}", OutputGroups="{}", RelativeTolerance=0, RhinoVersion="7.36.23346.16351", UnitSystem=0, VersionCreated="1.17.0.0", VersionSaved="1.17.0.0"})
# Description: This app will help you to evaluate how close do you live to certain amenities like parks, playgrounds etc. ...
# 
# To get started go to www.openstreetmap.org, zoom the location that you want to evaluate, right clik on the map, and choose "show adress". From the left sidebar copy the geogrphical coordinates and past them ...
title = Panel("Evaluate your city")

location_w_e = Panel("17.03434")
number = Number(location_w_e)
centerpoint_coordiantes_w_e = GetNumber(number, AtLeast=1, AtMost=1, Maximum=1.797693135e+308, Minimum=-1.797693135e+308, TreeAccess=False)

location_n_s = Panel("51.10765")
number_2 = Number(location_n_s)
centerpoint_coordinates_n_s = GetNumber(number_2, AtLeast=1, AtMost=1, Maximum=1.797693135e+308, Minimum=-1.797693135e+308, TreeAccess=False)

box_size = Panel("0.020")
division = Division(A=box_size, B=2)
division_2 = Division(A=division, B=1.5)

warsaw = Panel("20.99155")
warsaw_2 = Panel("52.23955")

barcelona = Panel("2.15728")
barcelona_2 = Panel("41.39233")

paris = Panel("2.34712")
paris_2 = Panel("48.89072")

vienna = Panel("16.40139")
vienna_2 = Panel("48.19906")

london = Panel("-0.09304")
london_2 = Panel("51.48972")

kopenhagen = Panel("12.54772")
kopenhagen_2 = Panel("55.67762")

addition = Addition(A=centerpoint_coordinates_n_s, B=division_2)
subtraction = Subtraction(A=centerpoint_coordinates_n_s, B=division_2)
addition_2 = Addition(A=centerpoint_coordiantes_w_e, B=division)
subtraction_2 = Subtraction(A=centerpoint_coordiantes_w_e, B=division)
text_join = TextJoin(Text=[subtraction_2, subtraction, addition_2, addition], Join=",")
data = Data(text_join)
bbox_left_bottom_right_top = Panel(data)
data_2 = Data(bbox_left_bottom_right_top)

panel = Panel("""service
residential""")
panel_2 = Panel("""motorway
trunk
primary
secondary
tertiary
unclassified""")
panel_3 = Panel("""footway
bridleway
steps
corridor
path
sidewalk
crossing
pedestrian
living street""")
get_data_from_osm = GetDataFromOSM(T=data_2, txt="highway", txt_2=[panel_2, panel])  # -> out_2, in_2, feat_2
get_data_from_osm_2 = GetDataFromOSM(T=data_2, txt="highway", txt_2=[panel_3, panel])  # -> out_2, in_2, feat_2

# ----
# OSM info: https://wiki.openstreetmap.org/wiki/Map_features
amenity = ValueList({"Park": 0, "Playground": 1, "Groceries": 2}, selected="Playground")
integer = Integer(amenity)
amenity_2 = GetInteger(integer, AtLeast=1, AtMost=1, Maximum=2147483647, Minimum=-2147483648, TreeAccess=False)
integer_2 = Integer(amenity_2)

get_data_from_osm_3 = GetDataFromOSM(T=data_2, txt="building")  # -> out_2, in_2, feat_2

panel_4 = Panel("""supermarket
convenience""")
get_data_from_osm_4 = GetDataFromOSM(T=data_2, txt="leisure", txt_2="playground")  # -> out_2, in_2, feat_2
get_data_from_osm_5 = GetDataFromOSM(T=data_2, txt="leisure", txt_2="park")  # -> out_2, in_2, feat_2
get_data_from_osm_6 = GetDataFromOSM(T=data_2, txt="shop", txt_2=panel_4)  # -> out_2, in_2, feat_2

import_osm_features = ImportOSMFeatures(OSMPathOrURL=get_data_from_osm_2.in_2, OSMFeatureType="street", Format="xml", ImportAltitude=False)  # -> Points, Metadata, UTMZone, TranslationVector
point = Point(import_osm_features.Points)
polyline = PolyLine(Vertices=point, Closed=False)
create_street_network = CreateStreetNetwork(
    StreetCurves=flatten(polyline),
    Metadata=flatten(import_osm_features.Metadata),
    SplitStreetCurves=True,
    UTMZone=import_osm_features.UTMZone,
    TranslationVector=import_osm_features.TranslationVector)  # -> StreetNetwork, StreetSegmentCurves, UTMZone, TranslationVector

import_osm_features_2 = ImportOSMFeatures(OSMPathOrURL=get_data_from_osm.in_2, OSMFeatureType="street", Format="xml", ImportAltitude=False)  # -> Points, Metadata, UTMZone, TranslationVector
point_2 = Point(import_osm_features_2.Points)
polyline_2 = PolyLine(Vertices=point_2, Closed=False)
create_street_network_2 = CreateStreetNetwork(
    StreetCurves=flatten(polyline_2),
    Metadata=flatten(import_osm_features_2.Metadata),
    SplitStreetCurves=True,
    UTMZone=import_osm_features_2.UTMZone,
    TranslationVector=import_osm_features_2.TranslationVector)  # -> StreetNetwork, StreetSegmentCurves, UTMZone, TranslationVector

stream_filter = StreamFilter(Gate=integer_2, Stream0=get_data_from_osm_5.in_2, Stream1=get_data_from_osm_4.in_2, Stream2=get_data_from_osm_6.in_2)
stream_filter_2 = StreamFilter(
    Gate=integer_2,
    Stream0=get_data_from_osm_5.feat_2,
    Stream1=get_data_from_osm_4.feat_2,
    Stream2=get_data_from_osm_6.feat_2)

import_osm_features_3 = ImportOSMFeatures(OSMPathOrURL=get_data_from_osm_3.in_2, OSMFeatureType=get_data_from_osm_3.feat_2, Format="xml", ImportAltitude=False)  # -> Points, Metadata, UTMZone, TranslationVector
point_3 = Point(import_osm_features_3.Points)
polyline_3 = PolyLine(Vertices=point_3, Closed=False)
create_building = CreateBuilding(BuildingCurve=polyline_3, Metadata=import_osm_features_3.Metadata)

import_osm_features_4 = ImportOSMFeatures(OSMPathOrURL=stream_filter, OSMFeatureType=stream_filter_2, Format="xml", ImportAltitude=False)  # -> Points, Metadata, UTMZone, TranslationVector
point_4 = Point(import_osm_features_4.Points)
stream_gate = StreamGate(Stream=point_4, Gate=integer_2)  # -> Target0, Target1, Target2

inspect_building = InspectBuilding(Building=create_building, DefaultHeight="14")  # -> Geometry, Metadata, Amenity, BuildingMesh
curve = Curve(flatten(inspect_building.Geometry))
mesh = Mesh(flatten(inspect_building.BuildingMesh))
clean_tree = CleanTree(RemoveNulls=True, RemoveInvalid=True, RemoveEmpty=invert(False), Tree=curve)

mesh_sphere = MeshSphere(Base=stream_gate.Target2, Radius="3", UCount=10, VCount=20)
polyline_4 = PolyLine(Vertices=[stream_gate.Target1, stream_gate.Target0], Closed=False)

merge = Merge(Data1=polyline_4, Data2=mesh_sphere)
bounding_box = BoundingBox(Content=flatten(merge), Plane=PlaneXY(0, 0, 0), UnionBox=True)  # -> Box, Box_2
bounding_box_2 = BoundingBox(Content=flatten(create_building), Plane=PlaneXY(0, 0, 0), UnionBox=True)  # -> Box, Box_2
bounding_box_3 = BoundingBox(Content=flatten([bounding_box_2.Box, bounding_box.Box]), Plane=PlaneXY(0, 0, 0), UnionBox=True)  # -> Box, Box_2
deconstruct_brep = DeconstructBrep(Brep=bounding_box_3.Box)  # -> Faces, Edges, Vertices
surface = Surface(deconstruct_brep.Faces)
area = Area(Geometry=surface)  # -> Area, Centroid
scale = Scale(Geometry=surface, Center=area.Centroid, Factor="1.1")  # -> Geometry, Transform
unit_z = UnitZ(Factor="50")
negative = Negative(Value=unit_z)
extrude = Extrude(Base=scale.Geometry, Direction=negative)
brep = Brep(extrude)
curve_2 = Curve(flatten(polyline_2))
curve_3 = Curve(flatten(polyline))
simple_mesh = SimpleMesh(Brep=brep)
trim_with_breps = TrimWithBreps(Curve=curve_2, Brep=brep)  # -> Inside, Outside
deconstruct_mesh = DeconstructMesh(Mesh=flatten(simple_mesh))  # -> Vertices, Faces, Colours, Normals

curve_4 = Curve(flatten(polyline_4))
unit_z_2 = UnitZ(Factor=0.1)
extrude_2 = Extrude(Base=curve_4, Direction=unit_z_2)

clean_tree_2 = CleanTree(RemoveNulls=True, RemoveInvalid=True, RemoveEmpty=invert(False), Tree=extrude_2)
cap_holes = CapHoles(Brep=clean_tree_2)
mesh_brep = MeshBrep(
    Brep=cap_holes,
    Settings={GridMaxCount=0, GridMinCount=16, JaggedSeams=False, MaxEdgeLength=0, MinEdgeLength=0.0001, MinTolerance=0, Refine=True, RefineAngle=0, RelativeTolerance=0.65, SimplePlanes=True, Tolerance=0})
deconstruct_mesh_2 = DeconstructMesh(Mesh=flatten(mesh_brep))  # -> Vertices, Faces, Colours, Normals

stream_filter_3 = StreamFilter(Gate=integer_2, Stream0=ColourSwatch(SwatchColor=RGB(125, 194, 64)), Stream1=ColourSwatch(SwatchColor=RGB(194, 64, 181)))
construct_mesh = ConstructMesh(Vertices=deconstruct_mesh_2.Vertices, Faces=deconstruct_mesh_2.Faces, Colours=stream_filter_3)  # -> flatten(Mesh)
context_bake = ContextBake(AllAmenities=construct_mesh)

trim_with_breps_2 = TrimWithBreps(Curve=curve_3, Brep=brep)  # -> Inside, Outside

deconstruct_brep_2 = DeconstructBrep(Brep=brep)  # -> Faces, Edges, Vertices
area_2 = Area(Geometry=brep)  # -> Area, Centroid
unit_z_3 = UnitZ(Factor=1)
list_item = ListItem(List=deconstruct_brep_2.Faces, Index=0, Wrap=True)
project_point = ProjectPoint(Point=area_2.Centroid, Direction=unit_z_3, Geometry=list_item)  # -> Point, Index

curve_5 = Curve(flatten(trim_with_breps.Inside))
colour_swatch = ColourSwatch(SwatchColor=RGB(115, 115, 115))
preview = CustomPreview(Geometry=curve_5, Material=colour_swatch)

colour_swatch_2 = ColourSwatch(SwatchColor=RGB(171, 171, 171))
curve_6 = Curve(flatten(trim_with_breps_2.Inside))
uservalue = Text(colour_swatch_2)
userkey = Text("color")
preview_2 = CustomPreview(Geometry=curve_6, Material=colour_swatch_2)

construct_mesh_2 = ConstructMesh(Vertices=deconstruct_mesh.Vertices, Faces=deconstruct_mesh.Faces, Colours=ColourSwatch(SwatchColor=RGB(212, 210, 210)))
context_bake_2 = ContextBake(FlatTerrainGeometry=construct_mesh_2)

point_5 = Point(project_point.Point)
strat_point = GetPoint(point_5, AtLeast=1, AtMost=1, Realtime=True, TreeAccess=False)

uservalue_2 = Text(colour_swatch)
userkey_2 = Text("color")

area_3 = Area(Geometry=clean_tree)  # -> Area, Centroid
closest_point = ClosestPoint(Point=point_5, Cloud=area_3.Centroid)  # -> ClosestPoint, CPIndex, Distance

c_script = CSharpScript(geometry=curve_6, userKey=userkey, userValue=uservalue)  # -> out, geoWithUserString; inputs geometry: GeometryBase, userKey: String, userValue: String
# ---------- c_script: C# ----------
    geometry.SetUserString(userKey, userValue);
   geoWithUserString = geometry;
# ---------- end c_script ----------
context_bake_3 = ContextBake(AllSidewalks=c_script.geoWithUserString)

c_script_2 = CSharpScript(geometry=curve_5, userKey=userkey_2, userValue=uservalue_2)  # -> out, geoWithUserString; inputs geometry: GeometryBase, userKey: String, userValue: String; same code as c_script
context_bake_4 = ContextBake(AllRoads=c_script_2.geoWithUserString)

cull_index = CullIndex(List=mesh, Indices=closest_point.CPIndex, Wrap=True)
clean_tree_3 = CleanTree(RemoveNulls=True, RemoveInvalid=True, RemoveEmpty=invert(False), Tree=cull_index)
deconstruct_mesh_3 = DeconstructMesh(Mesh=flatten(clean_tree_3))  # -> Vertices, Faces, Colours, Normals

list_item_2 = ListItem(List=flatten(clean_tree), Index=closest_point.CPIndex, Wrap=True)
list_item_3 = ListItem(List=flatten(mesh), Index=closest_point.CPIndex, Wrap=True)
deconstruct_mesh_4 = DeconstructMesh(Mesh=flatten(list_item_3))  # -> Vertices, Faces, Colours, Normals

construct_mesh_3 = ConstructMesh(
    Vertices=deconstruct_mesh_4.Vertices,
    Faces=deconstruct_mesh_4.Faces,
    Colours=ColourSwatch(SwatchColor=RGB(240, 192, 192)))
context_bake_5 = ContextBake(StartBuildingGeometry=construct_mesh_3)

construct_mesh_4 = ConstructMesh(
    Vertices=deconstruct_mesh_3.Vertices,
    Faces=deconstruct_mesh_3.Faces,
    Colours=ColourSwatch(SwatchColor=RGB(232, 232, 232)))
context_bake_6 = ContextBake(AllBuildingGeometry=construct_mesh_4)

integer_3 = Integer(Slider(10, range=5..15))
walking_time_min = GetInteger(integer_3, AtLeast=1, AtMost=1, Maximum=2147483647, Minimum=-2147483648, TreeAccess=False)
integer_4 = Integer(walking_time_min)

area_4 = Area(Geometry=list_item_2)  # -> Area, Centroid
pull_point = PullPoint(Point=area_4.Centroid, Geometry=polyline_4, ClosestOnly=True)  # -> flatten(ClosestPoint), Distance
router = Router(
    RouterUrbanoModelOrStreetNetwork=create_street_network.StreetNetwork,
    Origin=point_5,
    Destination=pull_point.ClosestPoint,
    TravelMode="pedestrian",
    TimeLimit=-1)  # -> Trip, Route, Time, Distance
panel_5 = Panel(router.Time)
smaller_than = SmallerThan(FirstNumber=router.Time, SecondNumber=integer_4)  # -> SmallerThan, OrEqualTo

dispatch = Dispatch(List=flatten(polyline_4), DispatchPattern=smaller_than.SmallerThan)  # -> ListA, ListB
dispatch_2 = Dispatch(List=router.Trip, DispatchPattern=smaller_than.SmallerThan)  # -> ListA, ListB
dispatch_3 = Dispatch(List=router.Route, DispatchPattern=smaller_than.SmallerThan)  # -> ListA, ListB

curve_7 = Curve(dispatch_3.ListA)

unit_z_4 = UnitZ(Factor=0.3)
curve_8 = Curve(dispatch.ListA)
extrude_3 = Extrude(Base=curve_8, Direction=unit_z_4)
cap_holes_2 = CapHoles(Brep=extrude_3)
mesh_brep_2 = MeshBrep(
    Brep=cap_holes_2,
    Settings={GridMaxCount=0, GridMinCount=16, JaggedSeams=False, MaxEdgeLength=0, MinEdgeLength=0.0001, MinTolerance=0, Refine=True, RefineAngle=0, RelativeTolerance=0.65, SimplePlanes=True, Tolerance=0})
deconstruct_mesh_5 = DeconstructMesh(Mesh=flatten(mesh_brep_2))  # -> Vertices, Faces, Colours, Normals

intrip = InspectTrip(Trip=dispatch_2.ListA)  # -> Origin, Destination, Time, Distance, Route, Mode, People, Activity, Amenity
list_length = ListLength(List=dispatch_2.ListA)
number_3 = Number(list_length)
number_4 = Number(intrip.Time)
number_5 = Number(intrip.Distance)
point_6 = Point(intrip.Destination)
integer_5 = Integer(number_3)
integer_6 = Integer(number_4)
integer_7 = Integer(number_5)

colour_swatch_3 = ColourSwatch(SwatchColor=RGB(0, 0, 0))
preview_3 = CustomPreview(Geometry=curve_7, Material=colour_swatch_3)

mesh_pipe = MeshPipe(Curve=curve_7, Radius="0.5", Accuracy=0.2, Rotation=0, Segments=10, Caps=2)
deconstruct_mesh_6 = DeconstructMesh(Mesh=flatten(mesh_pipe))  # -> Vertices, Faces, Colours, Normals

uservalue_3 = Text(colour_swatch_3)
userkey_3 = Text("color")

distance_in_meters = Panel(integer_7)

end_points = EndPoints(Curve=curve_7)  # -> Start, End
point_7 = Point([end_points.Start, end_points.End])
deconstruct = Deconstruct(Point=point_7)  # -> XComponent, YComponent, ZComponent
create_set = CreateSet(List=deconstruct.XComponent)  # -> Set, Map
create_set_2 = CreateSet(List=deconstruct.YComponent)  # -> Set, Map
construct_point = ConstructPoint(XCoordinate=create_set.Set, YCoordinate=create_set_2.Set, ZCoordinate=0)
mesh_sphere_2 = MeshSphere(Base=construct_point, Radius="1.8", UCount=10, VCount=20)
deconstruct_mesh_7 = DeconstructMesh(Mesh=flatten(mesh_sphere_2))  # -> Vertices, Faces, Colours, Normals

time_in_minutes = Panel(integer_6)
locations_within_the_range = Panel(integer_5)
c_script_3 = CSharpScript(geometry=curve_7, userKey=userkey_3, userValue=uservalue_3)  # -> out, geoWithUserString; inputs geometry: GeometryBase, userKey: String, userValue: String; same code as c_script
context_print = ContextPrint(LocationsWithinTheRange=integer_5)

construct_mesh_5 = ConstructMesh(Vertices=deconstruct_mesh_6.Vertices, Faces=deconstruct_mesh_6.Faces, Colours=colour_swatch_3)  # -> flatten(Mesh)
context_bake_7 = ContextBake(Geometry=construct_mesh_5)

context_print_2 = ContextPrint(DistanceInMeters=integer_7)
context_print_3 = ContextPrint(TimeInMinutes=integer_6)

stream_filter_4 = StreamFilter(Gate=integer_2, Stream0=ColourSwatch(SwatchColor=RGB(125, 194, 64)), Stream1=ColourSwatch(SwatchColor=RGB(194, 64, 181)))
construct_mesh_6 = ConstructMesh(Vertices=deconstruct_mesh_5.Vertices, Faces=deconstruct_mesh_5.Faces, Colours=stream_filter_4)  # -> flatten(Mesh)
context_bake_8 = ContextBake(AvailableAmenities=construct_mesh_6)

area_5 = Area(Geometry=curve_8)  # -> Area, Centroid
closest_point_2 = ClosestPoint(Point=point_6, Cloud=area_5.Centroid)  # -> ClosestPoint, CPIndex, Distance
text_tag = TextTag(Location=closest_point_2.ClosestPoint, Text=time_in_minutes)

construct_mesh_7 = ConstructMesh(Vertices=deconstruct_mesh_7.Vertices, Faces=deconstruct_mesh_7.Faces, Colours=ColourSwatch(SwatchColor=RGB(59, 59, 59)))  # -> flatten(Mesh)
context_bake_9 = ContextBake(StartEndPoints=construct_mesh_7)

# ==== cluster GetDataFromOSM
T = ClusterInput()
txt = ClusterInput()
txt_2 = ClusterInput()
txt_3 = ClusterInput()
txt_4 = Text(txt_2)
txt_5 = Text(txt_3)
txt_6 = Text(txt)
lng = ListLength(List=txt_6)
equals = Equality(FirstNumber=lng, SecondNumber="1")  # -> Equality, Inequality
concat = Concatenate(FragmentD=" modv=\"not\"", FragmentA=" v=\"", FragmentB=txt_5, FragmentC="\"")
concat_2 = Concatenate(FragmentA=" v=\"", FragmentB=txt_4, FragmentC="\"")
null = NullItem(Item=txt_4)  # -> NullFlags, InvalidFlags, Description
null_2 = NullItem(Item=txt_5)  # -> NullFlags, InvalidFlags, Description
split = TextSplit(Text=T, Separators=",")
filter = StreamFilter(Gate=null.NullFlags, Stream0=concat_2)
filter_2 = StreamFilter(Gate=null_2.NullFlags, Stream0=concat)
item = ListItem(List=split, Index=0, Wrap=True)  # -> Item, Item1, Item2, Item3
panel = Panel("""node
way
relation""")
merge = Merge(Data1=item.Item1, Data2=item.Item, Data3=item.Item3, Data4=item.Item2)  # -> flatten(Result)
merge_2 = Merge(Data1=filter, Data2=filter_2)  # -> flatten(Result)
concat_3 = Concatenate(
    FragmentA="<query type=\"",
    FragmentB=panel,
    FragmentC="\"><has-kv k=\"",
    FragmentD=txt_6,
    FragmentE="\"",
    FragmentF=graft(merge_2),
    FragmentG="/></query>")
join = TextJoin(Text=merge, Join=",")
lng_2 = ListLength(List=merge)
equals_2 = Equality(FirstNumber="4", SecondNumber=lng_2)  # -> Equality, Inequality
join_2 = TextJoin(Text=concat_3)  # -> flatten(Result)
join_3 = TextJoin(Text=join_2)
panel_2 = Panel("""<union>
<item/>
<recurse type="down"/>
</union>
<print mode="body"/>
</osm-script>""")
concat_4 = Concatenate(FragmentA="<union>", FragmentB=join_3, FragmentC="</union>")
concat_5 = Concatenate(FragmentA="<osm-script output=\"xml\" timeout=\"100\" bbox=\"", FragmentB=join, FragmentC="\">")
concat_6 = Concatenate(FragmentA=concat_5, FragmentD=concat_4, FragmentC=panel_2)
p_n_c = PickNChoose(Pattern=equals.Equality, Stream0="insert one and only key", Stream1=concat_6)
filter_3 = StreamFilter(Gate=equals_2.Equality, Stream1=p_n_c)
concat_7 = Concatenate(FragmentA="http://overpass-api.de/api/interpreter?data=", FragmentB=filter_3)
key = Text(txt)
out = Text(filter_3)
feat = Text(key)
in = Text(concat_7)
in_2 = ClusterOutput(in)
out_2 = ClusterOutput(out)
feat_2 = ClusterOutput(feat)
